% Simulink data dictionary PwmGenerator.sldd

pwm_freq = Simulink.Parameter(1000, DataType="double")  % Frequencia do PWM do controlador.
TTL_amplitude = Simulink.Parameter(5, DataType="double", Min=0, Max=5)  % Amplitude do sinal lógico PWM, relacionada ao sistema embarcado na fase de deploy.